# Dynamo graph AddSharedParameters.dyn (Dynamo 2.10.1.3976)
# packages: DYN_SharedParamTesting 1.0.0

file_path = Filename(".\SParametersAll.xlsx")
file_from_path = FileObject(path=file_path)
code_block = CodeBlock { "SharedParametersAssets"; false; false; }
importExcel = Data.ImportExcel(file=file_from_path, sheetName=code_block.out0, readAsStrings=code_block.out1, showExcel=code_block.out2)
restOfItems = List.RestOfItems(list=importExcel)
transpose = List.Transpose(lists=restOfItems)
code_block_2 = CodeBlock(data=transpose) { names = data[0]; parameter_group = data[1]; btg = data[2]; isinstance = data[3] == "Y"; }
addSharedParamsToFamily = RBG_VSNodes.Document.AddSharedParamsToFamily(SPParameterName=code_block_2.names, SPGroupName=code_block_2.parameter_group, BuiltInPG=code_block_2.btg, IsInstance=code_block_2.isinstance)
watch = Watch(addSharedParamsToFamily)
