# Dynamo graph AddSharedParametersCategory.dyn (Dynamo 2.10.1.3976)

createSharedParameter = Parameter.CreateSharedParameter()  # unwired: parameterName, groupName, type, group, instance, categoryList
file_path = Filename(".\SParameterBuilding.xlsx")
file_from_path = FileObject(path=file_path)
code_block = CodeBlock { "SharedParameters"; false; false; }
importExcel = Data.ImportExcel(file=file_from_path, sheetName=code_block.out0, readAsStrings=code_block.out1, showExcel=code_block.out2)
restOfItems = List.RestOfItems(list=importExcel)
transpose = List.Transpose(lists=restOfItems)
code_block_2 = CodeBlock(data=transpose)
# ---------- code_block_2.designscript (6 lines) ----------
parabuiltmeters = data[0];
group_name = data[1];
type = data[2];
built_in_group = data[3];
is_instance = data[4] == "Y";
category_list = Category.ByName(data[5]);
# ----------------------------------------
createProjectParameter = Parameter.CreateProjectParameter(parameterName=code_block_2.parabuiltmeters, groupName=code_block_2.group_name, type=code_block_2.type, group=code_block_2.built_in_group, instance=code_block_2.is_instance, categoryList=code_block_2.category_list)
watch = Watch(createProjectParameter)
